# Grasshopper definition voronoi_square.ghx (Grasshopper 0.9.61)
# plug-ins: HoopSnake

pt_11 = Point([Point(1, 0.876399219, 0), Point(0.5823675394, 0.7024240494, 0), Point(0.5838263035, 0.6875884533, 0), Point(0.585411191, 0.6833655238, 0), Point(1, 0.488155961, 0)])
pt_10 = Point([Point(0.5083261132, 0.06029708683, 0), Point(0.5050011277, 0, 0), Point(1, 0, 0), Point(1, 0.2988979518, 0), Point(0.7264284492, 0.2940396965, 0)])
pt_9 = Point([Point(0.585411191, 0.6833655238, 0), Point(0.5759431124, 0.5112661719, 0), Point(0.7264284492, 0.2940396965, 0), Point(1, 0.2988979518, 0), Point(1, 0.488155961, 0)])
pt_8 = Point([Point(0.4933142066, 1, 0), Point(0.5305920243, 0.7801134586, 0), Point(0.5823675394, 0.7024240494, 0), Point(1, 0.876399219, 0), Point(1, 1, 0)])
pt_2 = Point([Point(0, 0.1449322551, 0), Point(0, 0, 0), Point(0.5050011277, 0, 0), Point(0.5083261132, 0.06029708683, 0), Point(0.4899441302, 0.08859484643, 0), Point(0.2504092455, 0.2091281861, 0)])
pt_1 = Point([Point(0, 0.8289595246, 0), Point(0, 0.5050182939, 0), Point(0.08597300947, 0.4999365211, 0), Point(0.3752432168, 0.7458224297, 0)])
pt_3 = Point([Point(0, 1, 0), Point(0, 0.8289595246, 0), Point(0.3752432168, 0.7458224297, 0), Point(0.5305920243, 0.7801134586, 0), Point(0.4933142066, 1, 0)])
pt_4 = Point([Point(0.2991920114, 0.3889834881, 0), Point(0.2504092455, 0.2091281861, 0), Point(0.4899441302, 0.08859484643, 0), Point(0.4010044038, 0.3577587903, 0)])
pt_5 = Point([Point(0.08597300947, 0.4999365211, 0), Point(0.1866706014, 0.4714185297, 0), Point(0.5838263035, 0.6875884533, 0), Point(0.5823675394, 0.7024240494, 0), Point(0.5305920243, 0.7801134586, 0), Point(0.3752432168, 0.7458224297, 0)])
pt_6 = Point([Point(0.1866706014, 0.4714185297, 0), Point(0.2991920114, 0.3889834881, 0), Point(0.4010044038, 0.3577587903, 0), Point(0.5759431124, 0.5112661719, 0), Point(0.585411191, 0.6833655238, 0), Point(0.5838263035, 0.6875884533, 0)])
pt_7 = Point([Point(0.5759431124, 0.5112661719, 0), Point(0.4010044038, 0.3577587903, 0), Point(0.4899441302, 0.08859484643, 0), Point(0.5083261132, 0.06029708683, 0), Point(0.7264284492, 0.2940396965, 0)])
# Select the baked points
# and create a point list
# for each group.
pt_0 = Point([Point(0, 0.1449322551, 0), Point(0, 0.5050182939, 0), Point(0.08597300947, 0.4999365211, 0), Point(0.1866706014, 0.4714185297, 0), Point(0.2991920114, 0.3889834881, 0), Point(0.2504092455, 0.2091281861, 0)])
# Seed: 22
# Number of Points: 12
number_of_points = Slider(12, range=1..32)
panel = Panel(pt_0)
panel_2 = Panel(pt_2)
panel_3 = Panel(pt_1)
panel_4 = Panel(pt_7)
panel_5 = Panel(pt_10)
panel_6 = Panel(pt_3)
panel_7 = Panel(pt_4)
panel_8 = Panel(pt_5)
panel_9 = Panel(pt_6)
panel_10 = Panel(pt_8)
panel_11 = Panel(pt_9)
panel_12 = Panel(pt_11)
# Doesn't work :(
combine = CombineData(
    Input0=pt_0,
    Input1=pt_1,
    Input2=pt_2,
    Input3=pt_3,
    Input4=pt_4,
    Input5=pt_5,
    Input6=pt_6,
    Input7=pt_7,
    Input8=pt_8,
    Input9=pt_9,
    Input10=pt_10,
    Input11=pt_11)  # -> Result, Index
mult = Multiplication(FirstNumber=number_of_points, SecondNumber=3)
random = Random(Range=Domain(0, 1), Number=mult, Seed=Slider(22, range=0..100), Integers=False)
series = Series(Start=0, Step=3, Count=number_of_points)
series_2 = Series(Start=1, Step=3, Count=number_of_points)
series_3 = Series(Start=2, Step=3, Count=number_of_points)
pt = Point(combine.Result)
item = ListItem(List=random, Index=series_3, Wrap=False)
item_2 = ListItem(List=random, Index=series_2, Wrap=False)
item_3 = ListItem(List=random, Index=series, Wrap=False)
pt_12 = ConstructPoint(XCoordinate=item_3, YCoordinate=item_2, ZCoordinate=0)
sort_pt = SortPoints(Points=pt_12)  # -> Points, Indices
panel_13 = Panel(sort_pt.Points)
points = PointList(Points=sort_pt.Points, Tags=True, Lines=True)
box = Box({Plane=Plane(origin=(0, 0, 0), x=(0, 1, 0), y=(1, 0, 0)), X=Domain(0, 1), Y=Domain(0, 1), Z=Domain(0, 0)})
knob = ControlKnob(Decimals=2, Limit=True, Maximum=10, Minimum=0, Range=1, Value=0)
hs = HoopSnake(
    StartingData=sort_pt.Points,
    Data=pcen.CenterV,
    Hoopsnake_Data_autoUpdate=False,
    Hoopsnake_Data_dataLimit=2147483647,
    Hoopsnake_Data_resetCounter=True,
    Hoopsnake_Data_updateView=True)  # -> Feedback, FeedbackHistory, LoopsCounter, IterationsCounter
voronoi = Voronoi(Points=hs.Feedback, Boundary=box, BruteForceOverride=False)
pcen = PolygonCenter(Polyline=voronoi)  # -> CenterV, CenterE
demesh = DeconstructMesh(Mesh=voronoi)  # -> Vertices, Faces, Colours, Normals
panel_14 = Panel(demesh.Vertices)
pt_13 = Point(flatten(demesh.Vertices))
cullpt = CullDuplicates(Points=pt_13, Tolerance=knob, CullMode=3)  # -> Points, Indices, Valence
# Bake these points and
# delete the baked points
# you don't need
panel_15 = Panel(cullpt.Points)
